# Grasshopper definition PV_panel_Rh7.gh (Grasshopper 1.0.7)
# plug-ins: LadybugGrasshopper

# ----
# step to use:
# 1- insert geometry
# 2-insert Epw
# 3- set inclination of necessary
# 4-toggle to true if necessary
inclination = Slider(0, range=0..100)
monthly = LBFalseStartToggle(False)
geometry = Geometry([<brep referenced from the Rhino model> x21])
epw = FilePath("C:\Users\ASUS\Downloads\project_Rome\ITA_LZ_Roma-Ciampino.AP.162390_TMYx.2009-2023\ITA_LZ_Roma-Ciampino.AP.162390_TMYx.2009-2023.epw")
pv_initializer = PV_initializer(buildings=flatten(geometry), EPW_file=epw, monthly_period=monthly)  # -> roofs, pv_data_pack, period_hoys; inputs buildings: list of Brep
# ---------- pv_initializer: Python ----------
import ghpythonlib.components as gh
import ghpythonlib.component as ghc
import rhinoscriptsyntax as rh 
import math 
import csv
from datetime import datetime, timedelta
from collections import namedtuple
from ghpythonlib.treehelpers import list_to_tree



                
#decription of the inputs 
ghenv.Component.Params.Input[0].Description = 'Rhino Breps representing for which PV panel output will be calculated. Please make sure that the input is flatten and you are introducing proper geometry (must be solid valid polySurface).'
ghenv.Component.Params.Input[1].Description = 'An _EPW_file path as a string on your system'
ghenv.Component.Params.Input[2].Description = 'Inclination of the PV panels as a number. If you do not indicate inclination, the algorithm recognizes the installation strategy as horizontal.\nThe default value is 0 or horizontal.\n'
'Note: latitude of any location, as rule of thumb, is considered the best inclination. '
ghenv.Component.Params.Input[3].Description = ' Set to "true" if monthly analysis is required. if not inserted, the whole year will be considered by Ladybug'
                        
ghenv.Component.Params.Output[0].Description = 'Picked roof(s) for which PV panel output will be calculated'
ghenv.Component.Params.Output[1].Description = 'This output should be connected to pv_output_calculator.'
                
ghenv.Component.Name = 'PV_initializer'
ghenv.Component.NickName = 'PV_initializer'
#ghenv.Component.Message = '23.5.2025'
ghenv.Component.Category = 'PV_panel'
ghenv.Component.Description = 'This component provides necessary data to proceed with (PV_output_calculator).'
                
#passing data
roofs = []
location_info = []
alt_spacing = []


def epw_open(input_file, ang): 
    #index related to information needed as list
    if(input_file):
    #check the value from EPW file
        with open(input_file, 'r') as epw:
            reader = csv.reader(epw)
            location = next(reader)
            location_data =(location [1] , location [6] , location [7])
            latitude = float(location [6])
            longitude = float(location [7])
            timezone = float(location[8])
            
            # Skip the first 8 lines of EPW file to provie other required information
            for _ in range(7):
                next(reader)
                
            model_year = []
            for row in reader:
                model_year.append(str(row[0]))
            #take necessary info for location, lat and long
            model_year_bounds = str(gh.Bounds(model_year)).split(",")
            location_info.append(
                '1. Environmental and Geographical:\n\n'
                'Location: {}\n'.format(location_data[0])  +
                'Latitude: {:.2f}\n'.format(float(location_data[1])) +
                'Longitude: {}\n'.format(float(location_data[2])) +
                'Weather Data Source: EPW file based on model years {}-{}\n\n'.format(model_year_bounds[0], model_year_bounds[1]))
    
    
    
        def formula_alt(latitude, longitude,timzone):
            date_time = datetime(2024, 12, 31, 12, 0, 0) 
            lat_rad = math.radians(latitude)
            # Day of the year
            N = date_time.timetuple().tm_yday
            # Solar Declination (δ)
            delta = 23.45 * math.sin(math.radians((360 / 365) * (N - 81)))
            # Hour Angle (γ)
            Lstm = 15 * float(timzone)
            TC1 = 4*(longitude-Lstm)
            B = math.radians((360 / 365) * (N - 81))
            EOT = 9.87 * math.sin(2 * B) - 7.53 * math.cos(B) - 1.5 * math.sin(B)
            TC = TC1 + EOT
            LT = 12 # winter December 21 at solar noon 
            LST = LT + (TC / 60)
            gamma = 15 * (LST - 12)
            
            # Solar Elevation Angle (α)
            alt_spacing.append((
                math.degrees(math.asin(
                    math.sin(lat_rad) * math.sin(math.radians(delta)) +
                    math.cos(lat_rad) * math.cos(math.radians(delta)) * math.cos(math.radians(gamma))
                )),
                ang
            ))

    if ang > 0:
        formula_alt(latitude, longitude, timezone)
    else: 
        alt_spacing.append((0,0))



def roof_picker(BUI,ang):
    for brep in BUI:
        dec = gh.DeconstructBrep(brep)
        for i in range(len(dec[0])):
            cent = gh.Area(dec[0][i])[1]
            norm = gh.EvaluateSurface((dec[0][i]) ,cent)[1]
            if norm[2]==1:
                if cent[2] > 0 :
                    roofs.append(dec[0][i])
            if norm[2]==-1 and cent[2] > 0:
                roofs.append(dec[0][i])
    if ang > 0:
        if len(BUI) == 1:
            cen = gh.ConstructPoint(0,0,max(gh.Deconstruct(gh.Area(roofs)[1])) + 20) 
        else:
            cen = gh.ConstructPoint(0,0,max(gh.Deconstruct(gh.Area(roofs)[1])[2]) + 20)
            
        plane = gh.Rectangle(cen, 2, 2, 0)[0]
        ax = gh.Explode(plane, True)[0][0]
        tiltPlane= gh.RotateAxis(plane, gh.Radians(ang), ax)[0]
        roofs.append(gh.BoundarySurfaces(tiltPlane))


def data_maker(period):
    required_hours = [] 
    if period: 
        monthly_hours = (744 , 672, 744 , 720, 744, 720, 744, 744, 720, 744, 720, 744 )
        prevIndx = 0
        for month in range(12) : 
            required_hours.append(range(prevIndx , monthly_hours[month]+prevIndx))
            prevIndx += monthly_hours[month]
        required_hours = list_to_tree(required_hours)
    return required_hours

monthly_period = False if monthly_period is None else monthly_period
period_hoys = data_maker(monthly_period)
pv_data_pack = location_info,alt_spacing



################################################################################


def main():
    # inputs' value 
    angle = 0 if angel_ == None else angel_
    input_file = ghc.add_error('_EPW_file is failed to collect data!') if _EPW_file == None else _EPW_file
    if gh.ListLength(_buildings) == 0 :
        ghc.add_warning('The input _building is failed to collect data or there is a problem with inserted Geometry!') 
    else :
        epw_open(input_file, angle)
        roof_picker(_buildings,angle)

main()
# ---------- end pv_initializer ----------

importepw = LBImportEPW(epw_file=epw)  # -> location, dry_bulb_temperature, dew_point_temperature, relative_humidity, wind_speed, wind_direction, direct_normal_rad, diffuse_horizontal_rad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; plug-in component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
# step to use:
# 1- insert context geometry
# 2-run the simulation
run_the_simulator = LBFalseStartToggle(True)
skymatrix = LBCumulativeSkyMatrix(
    location=importepw.location,
    direct_rad=importepw.direct_normal_rad,
    diffuse_rad=importepw.diffuse_horizontal_rad,
    hoys=pv_initializer.period_hoys)  # -> out, sky_mtx; plug-in component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
context = Geometry([<brep referenced from the Rhino model> x276])
incidentradiation = LBIncidentRadiation(
    sky_mtx=skymatrix.sky_mtx,
    geometry=flatten(pv_initializer.roofs),
    context=flatten(context),
    grid_size="5",
    offset_dist="0.05",
    cpu_count=run_the_simulator,
    run=run_the_simulator)  # -> out, points, results, total, mesh, legend, title, int_mtx; plug-in component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

number_slider = Slider(0.22, range=0..1)
pv_configurator = PV_configurator(
    module_length=Slider(2.279, range=0..10),
    module_width=Slider(1.134, range=0..10),
    module_capacity=Slider(600, range=0..1000))  # -> PV_system; inputs module_capacity: Int32
# ---------- pv_configurator: Python ----------
#solar_panel= {0: ["Mono-Si" ,1.75]}
import ghpythonlib.component as ghc

                
#decription of the inputs 
ghenv.Component.Params.Input[0].Description = "A rating your module is given to determine how much sunlight it absorbs and converted into usable electricity as percentage"
ghenv.Component.Params.Input[1].Description = 'Module lenfth e.g., 1.1m (unite meter)'
ghenv.Component.Params.Input[2].Description = 'Module width e.g., 1.1m (unite meter)'
ghenv.Component.Params.Input[3].Description = 'The Nominal Maximum Power of PV systems is given in W by manufacturer.'



"eff_list.append(pvSystem[0] * (1 - 0.0035 * ((t_amb + ((44 - 25) / 1000) * ghi_h) - 25)))"

                        
                        
                        
                        
                        
ghenv.Component.Params.Output[0].Description = 'The defined PV system data'
                
ghenv.Component.Name = 'PV_configurator'
ghenv.Component.NickName = 'PV_configurator'
ghenv.Component.Message = '23.5.2025'
ghenv.Component.Category = 'PV_panel'
ghenv.Component.Description = 'This component make an user defined PV system.'
                


PV_system = []

def main():
 

    try:
        if (module_efficiency == None and module_capacity == None):
            raise ValueError("It is necesary to provide either module-efficency or module-capacity.")
            
        module_cap = module_length*module_width*(module_efficiency*1000) if module_capacity is None else module_capacity
        
        module_eff = ((module_cap/1000)/(module_length*module_width)) if module_efficiency is None else module_efficiency
        if module_eff > .30:
            raise ValueError("The module efficency seems too high, Please control the inputs")
        
        if (module_length == None or module_width == None):
            raise ValueError("The dimensions are mandatory")

        if None not in ((module_eff, module_length, module_width, module_cap)):
            lowerbound, biggerbound = module_cap - 10 , module_cap + 10
            modul_cap_calculated = int((module_length*module_width*module_eff)*1000)

            if not (lowerbound <= modul_cap_calculated <= biggerbound):
                raise ValueError("The inputs value are not corrisponding beacuse the dimension and the module efficiency\n"
                "indicate that the module capcaity should be around {} Wp but the input value is {} Wp.".format(
                int(modul_cap_calculated), int(module_cap)))
        
        PV_system.append((module_eff, module_length, module_width, module_cap))




    except ValueError, e:
        ghc.add_warning(str(e))
        
        

main()
# ---------- end pv_configurator ----------

reduction_coeeficent = Slider(50, range=0..100)
single_buildings = LBFalseStartToggle(False)
pv_estimator = PV_estimator(
    roofs=pv_initializer.roofs,
    points=flatten(incidentradiation.points),
    result=flatten(incidentradiation.results),
    pv_data_pack=pv_initializer.pv_data_pack,
    generate_single_building=single_buildings,
    reduction_coefficient=reduction_coeeficent,
    PV_system=pv_configurator)  # -> information; inputs roofs: list of GeometryBase, points: list of Point3d, result: list, pv_data_pack: list
# ---------- pv_estimator: Python ----------
import rhinoscriptsyntax as rs
import ghpythonlib.components as gh
import ghpythonlib.component as ghc
from collections import namedtuple
import math 

#Inputs 
ghenv.Component.Params.Input[0].Description = 'The geomtery of the PV panels'
ghenv.Component.Params.Input[1].Description = 'The grid of points that is be used to perform the incident radiation analysis.'
ghenv.Component.Params.Input[2].Description = 'The result(s) from the simulation is needed'
ghenv.Component.Params.Input[3].Description = 'The pv-data package by (PV_Data_Provide) should be connected here'
ghenv.Component.Params.Input[4].Description = 'Generating producation for each building (result in KWh/year)'
ghenv.Component.Params.Input[5].Description = 'The reduction coefficient presents a percentage of the roof that can be used to install PV system considering other obstructs such as AC system device. The default value is set to 50 percentage.' 
''
ghenv.Component.Params.Input[6].Description = "You can define your PV system using the 'PV_system_definer' component."
"By default, the system is configured with the following values:\nEfficiency: 20%\nPanel Dimensions: 1.75m (length) × 1m (width)\nPV Capacity: 350 Wp"
ghenv.Component.Params.Input[7].Description = 'Total energy consumpation in(KWh) of the buildings on which the pv panel are installed to calculate the energy compensentation.'
#Output       
ghenv.Component.Params.Output[0].Description = 'The result of PV panel installation based on the requested data on KWh/year.'

#componenet introducation 
                
ghenv.Component.Name = 'PV_estimator'
ghenv.Component.NickName = 'PV_estimator'
ghenv.Component.Message = '23.5.2025'
ghenv.Component.Category = 'PV_panel'
ghenv.Component.Description = 'This component provides final information for user.'
                

information = []

def pv_layout(roof,PV_PACK,PV_SYSTEM):
    
    def distance_within_panel(PV_PACK, PV_SYSTEM):
        if PV_PACK.altitude[0][0] != 0:
            LEN = PV_SYSTEM.length
            tilted_panel_length = []
            distance_value = LEN*math.sin(math.radians(PV_PACK.altitude[0][1]))/math.tan(math.radians(PV_PACK.altitude[0][0]))
            
            tilted_panel_length= LEN * math.cos(math.radians(PV_PACK.altitude[0][1]))
            pvTotalAreaNeeded = (distance_value + tilted_panel_length) * (PV_SYSTEM.width)
        else:
            distance_value = 0
            pvTotalAreaNeeded = PV_SYSTEM.width*PV_SYSTEM.length  
  
        return distance_value, pvTotalAreaNeeded
        
    def Pv_installation(roof,distance,PV_PACK,PV_SYSTEM):
        roof= gh.CullIndex(roof,-1,True) if distance[0] > 0 else roof
        roofs_area = []
        possibile_roofs_installation = []
        possibile_panels_installation = [] 
        pv_effective_area = []
        pv_occupied_area = []
        if gh.ListLength(roof) != 1:
            for i in range(len(roof)):
                roofs_area.append((gh.Area(roof[i])[0]))
                possibile_roofs_installation.append((gh.Area(roof[i])[0])*PV_PACK.reducation_coe)
                possibile_panels_installation.append(int((possibile_roofs_installation[i] / distance[1]))) #distance 1 is pv_needed_area
                pv_effective_area.append(possibile_panels_installation[i] * (PV_SYSTEM.width*PV_SYSTEM.length)) # the actual or effective pv area
                pv_occupied_area.append(possibile_panels_installation[i] * distance[1])
        else:
            roofs_area.append((gh.Area(roof)[0]))
            possibile_roofs_installation.append((gh.Area(roof)[0])*PV_PACK.reducation_coe)
            possibile_panels_installation.append(int((possibile_roofs_installation[0]/ distance[1]))) #distance 1 is pv_needed_area
            pv_effective_area.append(possibile_panels_installation[0] * (PV_SYSTEM.width*PV_SYSTEM.length)) # the actual or effective pv area
            pv_occupied_area.append(possibile_panels_installation[0] * distance[1])
            
        return roofs_area, possibile_roofs_installation, possibile_panels_installation, pv_effective_area, pv_occupied_area
    distance = distance_within_panel(PV_PACK, PV_SYSTEM)
    pv_installation_data = Pv_installation(roof,distance,PV_PACK,PV_SYSTEM)

    PV = namedtuple("PV", [
    "spacing_row_distance", 
    "pv_needed_area", 
    "roofs_area", 
    "possibile_roofs_installation",
    "possibile_panels_installation",
    "pv_effective_area",
    "pv_occupied_area"
    ])

    pv = PV(
        distance[0],
        distance[1],
        pv_installation_data[0],
        pv_installation_data[1],
        pv_installation_data[2], 
        pv_installation_data[3], 
        pv_installation_data[4]
    )
    print pv.spacing_row_distance
    return pv



def info_provider_general (PV_PACK, PV_SYSTEM, RST,enegry_consumption, pv_layout): 
    isinclined = 1 if PV_PACK.altitude[0][0] != 0 else 0
    if isinclined:
        if not (len(RST)/12).is_integer():
            GTI = max(RST)
            GHI= gh.CullIndex(RST, RST.index(GTI),True)
            GHI_MAX = max(GHI)
            result_average = gh.Average(GHI)
            pv_actual_area = sum(pv_layout.pv_effective_area)
            losses = 1-((abs(GHI_MAX - result_average)/((GHI_MAX+ result_average)/2)) + 0.145)
            producation = ((pv_actual_area) * float(losses) * float(GTI) * float(PV_SYSTEM.module_efficiency))
            enegry_compensation = "N/A" if enegry_consumption is None else round((min(enegry_consumption / producation, 1.0)*100),2)
            information.append( "Photovoltaic (PV) System Performance Summary\n\n"
                                'Note: The presented results are based on average system loss assumptions applied uniformly across all ' 
                                'evaluated buildings to streamline the assessment process. Consequently, these figures may slightly '
                                'overestimate real-world performance. For more accurate projections, individual building assessments '
                                'are recommended.\n\n'+
                                 PV_PACK.location_info[0] +
                                '2.PV System Installation Details:\n\n'  + 
                                'Total Rooftop area:{:.2f}m².\n' .format(sum(pv_layout.roofs_area)) +
                                'Reducation coefficient:{}% of total roof area.\n'.format(PV_PACK.reducation_coe*100) +
                                'Rooftop area utilized :{:.2f}m².\n' .format(sum(pv_layout.possibile_roofs_installation)) +
                                'Effective area of the panels: {:.2f} m²\n'. format((sum(pv_layout.pv_effective_area))) +
                                'Number of Installed Panels: {} units\n'.format((sum(pv_layout.possibile_panels_installation))) +
                                'PanelTilt Angle: {}°\n' . format(PV_PACK.altitude[0][1]) +
                                'Row Spacing:{:.2f} m  \n' .format(pv_layout.spacing_row_distance) +
                                'Panel Dimensions: {} m × {} m \n'.format(PV_SYSTEM.length,PV_SYSTEM.width) +
                                'Total Installed Capacity: {:.2f} kWp\n\n'.format((sum(pv_layout.possibile_panels_installation))*(PV_SYSTEM.power_rating/1000))+
                                
                                '3. PV Panel technical Specifications:\n' 
                                'Panel Capacity: {} Wp\n'.format(int(PV_SYSTEM.power_rating)) +
                                'Efficiency: {}%\n'.format(int(PV_SYSTEM.module_efficiency*100)) +
                                '\n\nEnergy producation:\n' 
                                'The maximum Global Tilted Irradiance(GTI):{:.2f} kWh/m²/year\n'.format(GTI) +
                                'System losses: {:.3f}% (average value applied across all buildings).\n'.format((1 - losses)*100)  +
                                'Estimated Annual Energy Production: {:.3f} GWh/year.\n'.format(producation/1000000) +
                                'Energy compensation percentage:{}'. format(enegry_compensation)
                                )
        else:
            result_corrected_tree = []
            current_month = 0 
            actual_list = int(len(RST)/12)
            #making proper list 
            for _ in range(12):
                result_corrected_tree.extend([RST[current_month : actual_list+current_month]])
                current_month += actual_list
            #in kwh/m2
            inclined_ghi = []
            horizontal_ghi_max = []
            horizontal_ghi_avg = []
            for monthly_ghi in result_corrected_tree:
                #inclined surface GHI
                inclined_ghi.append(monthly_ghi[-1])
                #recognize the inclined surface and taken out the values to calculate shading loss
                horizontal_ghi_value = monthly_ghi[ : actual_list-1] 
                horizontal_ghi_max.append(max(horizontal_ghi_value))
                horizontal_ghi_avg.append(gh.Average(horizontal_ghi_value))
                
            pv_actual_area = sum(pv_layout.pv_effective_area)
            pv_efficiency= PV_SYSTEM.module_efficiency
            
            for max_ghi_monthly,avg_ghi_monthly in zip(horizontal_ghi_max,horizontal_ghi_avg) :
                losses_monthly = 1-((abs(max_ghi_monthly - avg_ghi_monthly)/
                ((max_ghi_monthly+ avg_ghi_monthly)/2)) + 0.145)
                #in mwh
                information.append(round(pv_actual_area * float(losses_monthly) * 
                float(max_ghi_monthly) * float(pv_efficiency),2)) 
    else:
        if not (len(RST)/12).is_integer():
            GHI_MAX = max(RST)
            result_average = gh.Average(RST)
            pv_actual_area = sum(pv_layout.pv_effective_area)
            losses = 1-((abs(GHI_MAX - result_average)/((GHI_MAX+ result_average)/2)) + 0.145)
            producation = ((pv_actual_area) * float(losses) * float(GHI_MAX) * float(PV_SYSTEM.module_efficiency))
            enegry_compensation = "N/A" if enegry_consumption is None else  round((min(producation / enegry_consumption, 1.0)*100),2)
            
            
            information.append( "Photovoltaic (PV) System Performance Summary\n\n"
                                'Note: The presented results are based on average system loss assumptions applied uniformly across all ' 
                                'evaluated buildings to streamline the assessment process. Consequently, these figures may slightly '
                                'overestimate real-world performance. For more accurate projections, individual building assessments '
                                'are recommended.\n\n'+
                                 PV_PACK.location_info[0] +
                                '2.PV System Installation Details:\n\n'  + 
                                'Total Rooftop area:{:.2f}m².\n' .format(sum(pv_layout.roofs_area)) +
                                'Reducation coefficient:{}% of total roof area.\n'.format(PV_PACK.reducation_coe*100) +
                                'Rooftop area utilized :{:.2f}m².\n' .format(sum(pv_layout.possibile_roofs_installation)) +
                                'Effective area of the panels: {:.2f} m²\n'. format((sum(pv_layout.pv_effective_area))) +
                                'Number of Installed Panels: {} units\n'.format((sum(pv_layout.possibile_panels_installation))) +
                                'PanelTilt Angle: {}°\n' . format(PV_PACK.altitude[0][0]) + 
                                'Row Spacing: N/A\n' 
                                'Panel orientation: NOT applied\n' 
                                'Panel Dimensions: {} m × {} m \n'.format(PV_SYSTEM.length,PV_SYSTEM.width) +
                                'Total Installed Capacity: {} kWp\n\n'.format((sum(pv_layout.possibile_panels_installation))*(PV_SYSTEM.power_rating/1000))+
                                
                                '3. PV Panel technical Specifications:\n' 
                                'Panel Capacity: {} Wp\n'.format(int(PV_SYSTEM.power_rating)) +
                                'Efficiency: {}%\n'.format(int(PV_SYSTEM.module_efficiency*100)) +
                                '\n\nEnergy producation:\n' 
                                'Global Horizontal Irradiance (GHI): {:.2f} KWh/m² \n'.format((GHI_MAX))  +
                                'System losses: {:.3f}% (average value applied across all buildings).\n'.format((1 - losses)*100) +
                                'Estimated Annual Energy Production: {:.3f} GWh/year.\n'.format(producation/1000000) +
                                'Energy compensation percentage:{}'. format(enegry_compensation)
                                )
        else:
             #if yes that is monthly request 
            # making the list legibile with GH
            result_corrected_tree = []
            current_month = 0 
            actual_list = int(len(RST)/12)
            #making proper list 
            for _ in range(12):
                result_corrected_tree.extend([RST[current_month : actual_list+current_month]])
                current_month += actual_list
            #in kwh/m2
            horizontal_ghi_max = []
            horizontal_ghi_avg = []
            for monthly_ghi in result_corrected_tree:
                #recognize the inclined surface and taken out the values to calculate shading loss
                horizontal_ghi_value = monthly_ghi[ : actual_list] 
                horizontal_ghi_max.append(max(horizontal_ghi_value))
                horizontal_ghi_avg.append(gh.Average(horizontal_ghi_value))

            total_area =sum(pv_layout.pv_effective_area)
            pv_efficiency= PV_SYSTEM.module_efficiency
            
            for max_ghi_monthly,avg_ghi_monthly in zip(horizontal_ghi_max,horizontal_ghi_avg) :
                losses_monthly = 1-((abs(max_ghi_monthly - avg_ghi_monthly)/
                ((max_ghi_monthly+ avg_ghi_monthly)/2)) + 0.145)
                #in mwh
                information.append(round(total_area * float(losses_monthly) * 
                float(max_ghi_monthly) * float(pv_efficiency),2)) 


def info_provider_single(PV_PACK, RST , PTS , ROF, pv_layout,PV_SYSTEM):
    
    if (len(RST)/12).is_integer():
        ghc.add_error("Single building simualtion is designed for general analysis for a year, hence for monthly it is not possibile")
    else:
        sum_va = []
        isinclined = 1 if PV_PACK.altitude[0][0] != 0 else 0
        #can be improved
        if isinclined:
            GTI = max(RST)
            #eliminate the last item which is the inlined panel
            PTS_corrected, ROF_corrected, RES_corrected= gh.CullIndex(PTS, -1,True) , gh.CullIndex(ROF,-1,True), gh.CullIndex(RST,-1,True)
            for i in ROF_corrected:
                pat = []
                geo= gh.Extrude(i , gh.UnitZ(2))
                value = []
                for pt  in  PTS_corrected:
                    pat.append(gh.PointInBrep( geo , pt , False))
                for y in range(len(pat)):
                    if pat[y] == 1:
                        value.append(RST[y])
                sum_va.append(gh.Average(value))
            GHI=max(RES_corrected)
            if sum_va:
                for x,i in enumerate(sum_va):
                    loss = (abs(GHI - i)/((GHI + i)/2))+.145
                    pv_actual_area = pv_layout.pv_effective_area
                    building_pro = []
                    building_pro.append(int((pv_actual_area[x]) * (abs(loss-1)) * float(GHI) * float(PV_SYSTEM.module_efficiency)))
                    information.append(sum(building_pro))
        else:
            for i in ROF:
                pat = []
                geo= gh.Extrude(i , gh.UnitZ(2))
                value = []
                for pt  in  PTS:
                    pat.append(gh.PointInBrep( geo , pt , False))
                for y in range(len(pat)):
                    if pat[y] == 1:
                        value.append(RST[y])
                sum_va.append(gh.Average(value))
            GHI=max(RST)
            if sum_va:
                for x,i in enumerate(sum_va):
                    loss = (abs(GHI - i)/((GHI + i)/2))+.145
                    pv_actual_area = pv_layout.pv_effective_area
                    building_pro = []
                    building_pro.append(int((pv_actual_area[x]) * (abs(loss-1)) * float(GHI) * float(PV_SYSTEM.module_efficiency)))
                    information.append(sum(building_pro))




def main():
    
    rst = ghc.add_warning('_result is failed to collect data !') if gh.ListLength(_result) == 1 else _result
    geo = ghc.add_warning('_geometry is failed to collect data !') if len(_roofs) == 0 else _roofs
    pts = ghc.add_warning('_points is failed to collect data!') if gh.ListLength(_points) < 1 else _points
    reduction_coe = 0.5 if reduction_coefficient is None else reduction_coefficient/100
    consumption = None if Energy_consumption_total is None else float(Energy_consumption_total)
    single_pro = 0 if _generate_single_building_ is None else _generate_single_building_

    pv_data_pack = ghc.add_warning('_pv_data_pack input  is failed to collect data !') if gh.ListLength(_pv_data_pack) == 0 else _pv_data_pack
    PV_data_pack = namedtuple("data_pack", [
    "location_info","altitude", "reducation_coe"])
    pv_data_pack = PV_data_pack(pv_data_pack[0], pv_data_pack[1], reduction_coe)

    PVSystem = namedtuple("pvSystem", [
        "module_efficiency", "length", "width", "power_rating"
    ])
    
    default_model = PVSystem(0.21, 1.564 , 1.144, 360)
    pvSystem = default_model if PV_system is None else PVSystem(*PV_system)
    
    
    if ((gh.NullItem(rst)[0] != False) and (gh.NullItem(geo)[0]) != False):
        Pv_installation_data = pv_layout(geo,pv_data_pack,pvSystem)
        if (single_pro == 0): 
            info_provider_general (pv_data_pack, pvSystem,rst,consumption,Pv_installation_data)
        else :
            info_provider_single(pv_data_pack, rst , pts , geo, Pv_installation_data,pvSystem)
    else:
        ghc.add_warning('Run the simulation to estimate the producation')


main()
# ---------- end pv_estimator ----------

# ---- group: use to see the buildings index
area = Area(Geometry=pv_initializer.roofs)  # -> Area, Centroid
point_list = PointList(Points=area.Centroid, Size=Slider(10, range=0..10))

# ---- group: use to generate graph
point = Point(<point referenced from the Rhino model>)
graph_maker = GraphMaker(values=pv_estimator, base_point=point)

# ----
# step to use:
# 1-change the reducation coefficent to change the
# roof usage percentage
# 2-pv system can be defined by a real data from
# any proucation site to create differnet scenarios
# 3-energy consumaption can be added in case of
# general information to calcualted the energy
# conpensation
# 
# note:
# general infomation which is set as default give
# technical, environemntal, mechnical info about the
# whole system.
# if it is required to simualte pv for each building
# toggle the bolean and use the point number to see
# about which building the calculate has been done,
panel = Panel(pv_estimator)

# ==== cluster GraphMaker
values = ClusterInput()
base_point = ClusterInput()
base_point_2 = Point(base_point)
panel = Panel("""1: January  
2: February  
3: March  
4: April  
5: May  
6: June  
7: July  
8: August  
9: September  
10: October  
11: November  
12: December""")
constrtype = LBConstructDataType(name="solar radiation producation", unit="MWh/y", categories=panel)  # -> type; plug-in component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
ghpython_script = GhPythonScript(values=values)  # -> out, min, max; inputs values: list
# ---------- ghpython_script: Python ----------
import ghpythonlib.components as gh

print "Total Pv producation is {:.3f} GWh/year". format(sum(values)/1000)
    
min= gh.Bounds(values)[0]-(gh.Bounds(values)[0]*0.4)  if min == None else min
max = gh.Bounds(values)[1]+(gh.Bounds(values)[1]*0.1) if max == None else max

if not 0 in (min, max):
    pass
else:
    min = gh.Bounds(values)[0]
# ---------- end ghpython_script ----------
constrheader = LBConstructHeader(data_type=constrtype, unit="MWh/y")  # -> header; plug-in component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
legendpar = LBLegendParameters(min=ghpython_script.min, max=ghpython_script.max)  # -> leg_par; plug-in component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
data = LBConstructData(header=constrheader, values=values, interval="monthly")  # -> data; plug-in component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
monthlychart = LBMonthlyChart(data=data, base_pt=base_point_2, global_title=ghpython_script.out, legend_par=legendpar)  # -> out, data_mesh, data_lines, col_lines, legend, borders, labels, y_title, title, vis_set; plug-in component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
visset = LBPreviewVisualizationSet(vis_set=flatten(monthlychart.vis_set))  # -> vs; plug-in component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
data_2 = Data([monthlychart.data_lines, monthlychart.col_lines, monthlychart.legend, monthlychart.borders, monthlychart.labels, monthlychart.y_title, monthlychart.title])
mesh = Mesh(monthlychart.data_mesh)
custom_preview = CustomPreview(Geometry=data_2, Material="black")
merge = Merge(Data1=mesh, Data2=data_2)
graph = Data(merge)
graph_2 = ClusterOutput(graph)
