# Grasshopper definition PV_panel_Rh7.gh (Grasshopper 1.0.7)
# plug-ins: LadybugGrasshopper

# ----
# 1:Step to use:
# 1-Insert the geometry data.
# 2-Import the EPW weather file.
# 3-Set the panel inclination if required.
# 4-Enable the toggle (True) if the option is needed.
# 1
inclination = Slider(30, range=0..100)
monthly = LBFalseStartToggle(False)
geometry = Geometry([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])
epw = FilePath("C:\Users\ASUS\Downloads\project_Rome\ITA_LZ_Roma-Ciampino.AP.162390_TMYx.2009-2023\ITA_LZ_Roma-Ciampino.AP.162390_TMYx.2009-2023.epw")
pv_initializer = PV_Initializer(buildings=flatten(geometry), EPW_file=epw, monthly_period=monthly)  # -> roofs, pv_data_pack, period_hoys; inputs buildings: list of Brep
# ---------- pv_initializer: Python ----------
import System
import Rhino
import Grasshopper

import rhinoscriptsyntax as rs
import System
import Rhino
import Grasshopper
import json
import rhinoscriptsyntax as rs
import ghpythonlib.components as gh
import ghpythonlib.component as ghc
import rhinoscriptsyntax as rh 
from Rhino.Geometry import Brep
import math 
import csv
from datetime import datetime, timedelta
from collections import namedtuple
from ghpythonlib.treehelpers import list_to_tree

# Role of the component:
# A) Gets building geometry and picks out the roof of the building to prepare a calculation surface on which Ladybug should simulate.
# B) Gets EPW weather file and extracts necessary data for simulation and corresponding calculations.
# C-D) If the user provided the inclination of the panels, calculates the Solar Elevation Angle to calculate the panel distances.
#      Moreover, takes the period preference of the user to create a proper data list,
#      based on which the data is passed to other components.

# Description of the inputs
ghenv.Component.Params.Input[0].Description = (
'Rhino Breps representing the buildings for which PV panel output will be calculated. '
'Please ensure the input is flattened and that you are providing valid geometry '
'(must be a solid, valid polySurface).'
)
ghenv.Component.Params.Input[1].Description = (
'An EPW file path as a string pointing to the file location on your system.'
)
ghenv.Component.Params.Input[2].Description = (
'Inclination of the PV panels in degrees. If no inclination is provided, the algorithm '
'assumes a horizontal installation strategy.\n'
'Default value: 0 (horizontal)'
)
ghenv.Component.Params.Input[3].Description = (
'Set to "True" to enable monthly analysis. '
'If not provided, the entire year will be considered by Ladybug.'
)

# Description of the Outputs
ghenv.Component.Params.Output[0].Description = (
'The selected roof surface(s) for which PV panel output will be calculated.'
)
ghenv.Component.Params.Output[1].Description = (
'This output should be connected to the PV_output_calculator component.'
)

# Description of component
ghenv.Component.Name = 'PV_Initializer'
ghenv.Component.NickName = 'PV_Initializer'
ghenv.Component.Category = 'PV_Panel'
ghenv.Component.Description = (
'Extracts building roof geometry and EPW weather data to prepare '
'the necessary inputs for PV energy simulation via PV_output_calculator.'
)

# --- CHANGES ---
# 1. Removed type hints from all function signatures (not supported in Python 2)
# 2. Replaced f-strings with .format() or % formatting
# 3. Replaced list[str] / list[Brep] / list[int] return type hints (not supported)
# 4. range() already returns a list in Python 2, but list() wrapping is kept for safety
# 5. next(reader) is valid in Python 2.6+, kept as-is

def cal_elevation(latitude, longitude, timezone):
    try:
        if all([latitude is not None, longitude is not None, timezone is not None]):
            # The row distance in PV fields is customarily determined by the shadow length on 21 December at solar noon
            # For more data check https://doi.org/10.3390/en14133850
            date_time = datetime(2024, 12, 21, 12, 0, 0)
            lat_rad = math.radians(latitude)
            N = date_time.timetuple().tm_yday

            # Solar Declination (δ)
            delta = 23.45 * math.sin(math.radians((360.0 / 365) * (N - 81)))
            # Hour Angle (γ)
            lstm = 15 * float(timezone)
            TC1 = 4 * (longitude - lstm)
            B = math.radians((360.0 / 365) * (N - 81))
            EOT = 9.87 * math.sin(2 * B) - 7.53 * math.cos(B) - 1.5 * math.sin(B)
            TC = TC1 + EOT
            LT = 12
            LST = LT + (TC / 60.0)
            gamma = 15 * (LST - 12)

            # Solar Elevation Angle (α)
            return (
                math.degrees(math.asin(
                    math.sin(lat_rad) * math.sin(math.radians(delta)) +
                    math.cos(lat_rad) * math.cos(math.radians(delta)) * math.cos(math.radians(gamma))
                )))
        else:
            raise ValueError("Latitude, longitude, or timezone is missing.")
    except Exception as e:
        raise RuntimeError("Solar elevation calculation failed: {0}".format(e))


def epw_open(epw_path):
    if not epw_path:
        raise ValueError("No EPW file path provided.")
    try:
        with open(epw_path, 'r') as epw:
            reader = csv.reader(epw)
            location = next(reader)
            location_data = (location[1], location[6], location[7])
            latitude  = float(location[6])
            longitude = float(location[7])
            timezone  = float(location[8])

            # Skip the first 8 lines of EPW file since they are not necessary data
            for _ in range(7):
                next(reader)

            model_year = []
            for row in reader:
                model_year.append(str(row[0]))

            # take necessary info for location, lat and long
            model_year_bounds = str(gh.Bounds(model_year)).split(",")
            return (
                (
                    "1. Environmental and Geographical:\n\n"
                    "Location: {0}\n"
                    "Latitude: {1:.2f}\n"
                    "Longitude: {2}\n"
                    "Weather Data Source: EPW file based on model years "
                    "{3}-{4}\n\n"
                ).format(
                    location_data[0],
                    float(location_data[1]),
                    float(location_data[2]),
                    model_year_bounds[0],
                    model_year_bounds[1]
                ),
                (latitude, longitude, timezone)
            )
    except IOError:
        raise IOError("EPW file not found at path: {0}".format(epw_path))
    except Exception as e:
        raise RuntimeError("[epw_open] Something went wrong: {0}".format(e))


def addTiltSurface(roofs, ang):
    try:
        if roofs:
            if len(roofs) == 1:
                cen = gh.ConstructPoint(0, 0, max(gh.Deconstruct(gh.Area(roofs)[1])) + 20)
            else:
                cen = gh.ConstructPoint(0, 0, max(gh.Deconstruct(gh.Area(roofs)[1])[2]) + 20)

            plane = gh.Rectangle(cen, 2, 2, 0)[0]
            ax = gh.Explode(plane, True)[0][0]
            tiltPlane = gh.RotateAxis(plane, gh.Radians(ang), ax)[0]
            return tiltPlane
        else:
            raise ValueError("The roof input is missed")
    except Exception as e:
        raise RuntimeError("Something went wrong: {0}".format(e))


def roof_picker(buildings, ang):
    roofs = []
    try:
        if len(buildings) > 0:
            for building in buildings:
                dec = gh.DeconstructBrep(building)
                for i in range(len(dec[0])):
                    cent = gh.Area(dec[0][i])[1]
                    norm = gh.EvaluateSurface((dec[0][i]), cent)[1]
                    if norm[2] == 1:
                        if cent[2] > 0:
                            roofs.append(dec[0][i])
                    if norm[2] == -1 and cent[2] > 0:
                        roofs.append(dec[0][i])
        else:
            raise ValueError("Building geometry could not be deconstructed!")

        # If inclined, add a single inclined surface to calculate Global Tilted Irradiance (GTI).
        # This method is used to save simulation time, considering the trade-off for inaccuracy which can be
        # acceptable for early stage of design.
        if ang > 0:
            tilt_panel = gh.BoundarySurfaces(addTiltSurface(roofs, ang))
            roofs.append(tilt_panel)
            print(tilt_panel)
        return roofs
    except Exception as e:
        raise RuntimeError("Something went wrong while handling buildings: {0}".format(e))


def data_maker(period):
    required_hours = []
    if period:
        monthly_hours = (744, 672, 744, 720, 744, 720, 744, 744, 720, 744, 720, 744)
        prev_index = 0
        for month in range(12):
            required_hours.append(list(range(prev_index, monthly_hours[month] + prev_index)))
            prev_index += monthly_hours[month]
        required_hours = list_to_tree(required_hours)
    return required_hours


roofs, pv_data_pack, period_hoys = None, None, None
try:
    # handle default values
    ang    = 0     if angle_ is None else angle_
    period = False if monthly_period is None else monthly_period

    # handle primary data
    locationInfo, locationData = epw_open(_EPW_file)
    latitude, longitude, timezone = locationData
    solar_elevation_angle = cal_elevation(latitude, longitude, timezone) if ang > 0 else 0

    # output
    roofs = roof_picker(_buildings, ang)
    pv_data_pack = json.dumps({
        "locationInfo": locationInfo,
        "spacing": (solar_elevation_angle, ang),
        "period": "{0}".format('yearly' if not period else 'monthly')
    })
    period_hoys = [] if not period else data_maker(period)

except Exception as e:
    ghc.add_warning("{0}".format(e))
# ---------- end pv_initializer ----------

# ---- group: Change this to your Ladybug version
# 2
importepw = LBImportEPW(epw_file=epw)  # -> location, dry_bulb_temperature, dew_point_temperature, relative_humidity, wind_speed, wind_direction, direct_normal_rad, diffuse_horizontal_rad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; plug-in component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
# 2:step to use:
# 1-Insert the context geometry.
# 2-Run the simulation.
# 
# Note: change this version of Ladybug if does not
# comply with yours.
run_the_simulator = LBFalseStartToggle(False)
skymatrix = LBCumulativeSkyMatrix(
    location=importepw.location,
    direct_rad=importepw.direct_normal_rad,
    diffuse_rad=importepw.diffuse_horizontal_rad,
    hoys=pv_initializer.period_hoys)  # -> out, sky_mtx; plug-in component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
context = Geometry()
incidentradiation = LBIncidentRadiation(
    sky_mtx=skymatrix.sky_mtx,
    geometry=flatten(pv_initializer.roofs),
    context=flatten(context),
    grid_size="5",
    offset_dist="0.05",
    cpu_count=run_the_simulator,
    run=run_the_simulator)  # -> out, points, results, total, mesh, legend, title, int_mtx; plug-in component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

# ----
# 4
number_slider = Slider(1.134, range=0..10)
number_slider_2 = Slider(800, range=0..1000)
# 4:step to use:
# Insert the characteristics of the PV panel you want to use.
# The required specifications can be obtained from the
# manufacturer’s website or from the product catalogues.
number_slider_3 = Slider(0.21, range=0..1)
pv_configurator = PV_configurator(module_efficiency=number_slider_3, module_length=Slider(1.4, range=0..10), module_width=number_slider)  # -> PV_system; inputs module_capacity: Int32
# ---------- pv_configurator: Python ----------
import System
import Rhino
import Grasshopper

import rhinoscriptsyntax as rs
import ghpythonlib.component as ghc
import json



# Component metadata
ghenv.Component.Name = 'PV_configurator'
ghenv.Component.NickName = 'PV_configurator'
ghenv.Component.Category = 'PV_panel'
ghenv.Component.Description = 'Configure custom photovoltaic (PV) module properties.'

# Input descriptions
ghenv.Component.Params.Input[0].Description = 'Module efficiency (0-1)'
ghenv.Component.Params.Input[1].Description = 'Module length (m)'
ghenv.Component.Params.Input[2].Description = 'Module width (m)'
ghenv.Component.Params.Input[3].Description = 'Module capacity (Wp)'

# Output description
ghenv.Component.Params.Output[0].Description = 'PV system data'


def validateInputs(eff, cap, width, length):
    errors = []
    message = ""

    if cap is None and eff is None:
        errors.append("Either module efficiency or module capacity must be provided.")
    if width is None or length is None:
        errors.append("Length and width are required.")
    if eff is not None and (eff <= 0 or eff > 0.30):
        errors.append("Efficiency seems incorrect, got {0}.".format(eff))
    if width is not None and width <= 0:
        errors.append("Module width must be greater than 0.")
    if length is not None and length <= 0:
        errors.append("Module length must be greater than 0.")

    if errors:
        numbered_errors = ["{0}-{1}".format(i + 1, err) for i, err in enumerate(errors)]
        message = (
            "\n\nPlease check the following inputs' error."
            + "\nRequired Inputs Missing:\n"
            + "\n".join(numbered_errors)
        )
        raise RuntimeError(message)


def calc_system(eff, cap, width, length):
    # power (kWp) = 1 kW/m2 * area * efficiency
    area = width * length
    if cap is None:
        cap = area * eff * 1000
    elif eff is None:
        eff = cap / (area * 1000.0)  # explicit float division

    return eff, cap


def check_Feasibility(eff, cap, width, length):
    calculated = round((length * width * eff * 1000), 2)
    if abs(cap - calculated) > 0.1:
        raise ValueError(
            "The capacity provided seems not to be correct, "
            "expected {0}W but got {1}W".format(calculated, cap)
        )


try:
    validateInputs(module_efficiency, module_capacity, module_width, module_length)
    eff, cap = calc_system(module_efficiency, module_capacity, module_width, module_length)

    if module_capacity is not None:
        check_Feasibility(eff, cap, module_width, module_length)

    PV_system = json.dumps({
        "eff"   : round(eff, 3),
        "length": module_length,
        "width" : module_width,
        "cap"   : round(cap, 2)
    })
except Exception as e:
    ghc.add_warning("{0}".format(e))
    PV_system = None
# ---------- end pv_configurator ----------

# ----
# 3
single_buildings = LBFalseStartToggle(False)
# 3:step to use:
# 1-Change the reduction coefficient to adjust the roof usage percentage.
# 2-The PV system can be defined using real manufacturer
# data to create different simulation scenarios.
# 3-You can enable the Single Building Calculation option to generate
# a list of production values corresponding to each building index.
# 
# Note that this option is not available for monthly calculations.
# 
# Note:
# The default General Information settings provide technical,
# environmental, and mechanical information about the entire system.
# 
# If you want to simulate the PV production for each building individually,
# enable the boolean option and use the point number to identify which
#  building the calculation corresponds to.
reduction_coeeficent = Slider(0.5, range=0..1)
pv_estimator = PV_estimator(
    roofs=pv_initializer.roofs,
    points=flatten(incidentradiation.points),
    result=flatten(incidentradiation.results),
    pv_data_pack=pv_initializer.pv_data_pack,
    generate_single_building=single_buildings,
    reduction_coefficient=reduction_coeeficent)  # -> information; inputs roofs: list of GeometryBase, points: list of Point3d, result: list
# ---------- pv_estimator: Python ----------
import System
import Rhino
import Grasshopper

import rhinoscriptsyntax as rs
import ghpythonlib.components as gh
import ghpythonlib.component as ghc
from collections import namedtuple
import math 
import json

# Role of the component:
# This component plays an important role to wrap all the data and calculate the PV output assumption
# the workflow here is :
# Get the result and point on which the simulation has been conducted ->
# evalute the roof area and all user inputs to provide required data for the formula of Pv Out calculation ->
# once you calculate it be ready for any scenario changes ->
# Provide data based on the user request : ->
# A) General information
# B) Monthly information
# C) annual information
# D) single building Production information

# Description of the inputs
ghenv.Component.Params.Input[0].Description = 'The geometry of the PV panels'
ghenv.Component.Params.Input[1].Description = 'The grid of points that is be used to perform the incident radiation analysis.'
ghenv.Component.Params.Input[2].Description = 'The result(s) from the simulation is needed'
ghenv.Component.Params.Input[3].Description = 'The pv-data package by (PV_Data_Provider) should be connected here'
ghenv.Component.Params.Input[4].Description = 'Generating Production for each building (result in KWh/year)'
ghenv.Component.Params.Input[5].Description = 'The reduction coefficient presents a percentage of the roof that can be used to install PV system considering other obstructs such as AC system device. The default value is set to 50 percentage.'
ghenv.Component.Params.Input[6].Description = (
    "You can define your PV system using the 'PV_system_definer' component."
    "By default, the system is configured with the following values:\nEfficiency: 20%\nPanel Dimensions: 1.75m (length) x 1m (width)\nPV Capacity: 350 Wp"
)

# Description of the Outputs
ghenv.Component.Params.Output[0].Description = 'The result of PV panel installation based on the requested data on KWh/year.'

# Description of component
ghenv.Component.Name = 'PV_estimator'
ghenv.Component.NickName = 'PV_estimator'
ghenv.Component.Message = '23.5.2025'
ghenv.Component.Category = 'PV_panel'
ghenv.Component.Description = 'This component provides final information for user.'


def find_distance(pv_pack, pv_system):
    tilted_panel_length  = 0
    panel_area_required  = 0
    distance_within_PV   = 0

    inclination = pv_pack["spacing"][1]
    spacing     = pv_pack["spacing"][0]
    length      = pv_system["length"]
    width       = pv_system["width"]

    if inclination:
        distance_within_PV  = length * math.sin(math.radians(inclination)) / math.tan(math.radians(spacing))
        tilted_panel_length = length * math.cos(math.radians(inclination))
        panel_area_required = (distance_within_PV + tilted_panel_length) * width
    else:
        distance_within_PV  = 0
        panel_area_required = length * width

    return tilted_panel_length, panel_area_required, distance_within_PV


def cal_PV_installation(roofs, panel_area_required, distance_within_PV, pv_pack, pv_system):
    roofs = list(roofs)
    roofs = roofs[:-1] if distance_within_PV > 0 else roofs
    roofs_area                    = []
    possible_roofs_installation   = []
    possible_panels_installation  = []
    pv_effective_area             = []
    pv_occupied_area              = []

    if gh.ListLength(roofs) == 1:
        roofs = [roofs]

    for i, roof in enumerate(roofs):
        width      = pv_system["width"]
        length     = pv_system["length"]
        roof_area  = gh.Area(roof)[0]
        roofs_area.append(roof_area)
        possible_roofs_installation.append(roof_area * reduction_coe)
        possible_panels_installation.append(int(possible_roofs_installation[i] / panel_area_required))
        pv_effective_area.append(possible_panels_installation[i] * (length * width))
        pv_occupied_area.append(possible_panels_installation[i] * panel_area_required)

    return roofs_area, possible_roofs_installation, possible_panels_installation, pv_effective_area, pv_occupied_area


def create_PV_layout(roofs, pv_pack, pv_system):
    pv_pack = json.loads(pv_pack)
    (tilted_panel_length, panel_area_required, distance_within_PV) = find_distance(pv_pack, pv_system)
    (roofs_area,
     possible_roofs_installation,
     possible_panels_installation,
     pv_effective_area,
     pv_occupied_area) = cal_PV_installation(roofs, panel_area_required, distance_within_PV, pv_pack, pv_system)


def get_Losses(res):
    result_average = gh.Average(res)
    return 1 - ((abs(max(res) - result_average) / ((max(res) + result_average) / 2.0)) + 0.145)


def cal_Production(res, pv_effective_area, eff, maxVal):
    losses = get_Losses(res)
    if isinstance(pv_effective_area, list):
        eff_Area = sum(pv_effective_area)
    else:
        eff_Area = pv_effective_area
    return round((eff_Area * float(losses) * float(maxVal) * float(eff)), 2)


def info_provider_general_yearly(res, pv_effective_area, eff, isinclined):
    if isinclined:
        res  = list(res)
        GTI  = max(res)
        GHI  = res[:-1]
        return cal_Production(GHI, pv_effective_area, eff, GTI)
    else:
        return cal_Production(res, pv_effective_area, eff, max(res))


def structure_monthly_result(res):
    res = list(res)
    result_corrected_tree = []
    monthly_count = int(len(res) / 12)
    for i in range(12):
        start = i * monthly_count
        end   = start + monthly_count
        result_corrected_tree.append(res[start:end])
    return result_corrected_tree


def info_provider_general_monthly(res, pv_effective_area, eff, isinclined):
    result_corrected_tree = structure_monthly_result(res)
    monthly_Production = []
    for monthly_ghi in result_corrected_tree:
        maxValue = max(monthly_ghi)
        if isinclined:
            maxValue    = monthly_ghi[-1]
            monthly_ghi = monthly_ghi[:-1]
        monthly_Production.append(cal_Production(monthly_ghi, pv_effective_area, eff, maxValue))
    return monthly_Production


def handelProducationValue(prod):
    if prod >= 1000000:
        return "{0:.2f} GWh/year".format(prod / 1000000.0)
    elif prod >= 1000:
        return "{0:.2f} MWh/year".format(prod / 1000.0)
    else:
        return "{0:.2f} kWh/year".format(prod)


def build_summary(
        roofs_area,
        possible_roofs_installation,
        pv_effective_area,
        possible_panels_installation,
        reduction_coe,
        pv_pack,
        PV_system,
        maxValue,
        losses,
        production,
        isInclined,
        distance_within_PV):

    if isInclined:
        solarPower = "The maximum Global Tilted Irradiance:{0:.2f} kWh/m2/year\n".format(maxValue)
        spacing    = "Panel Tilt Angle: {0}deg\nRow Spacing: {1:.2f} m\n".format(
                        pv_pack['spacing'][1], distance_within_PV)
    else:
        solarPower = "The maximum Global Horizontal Irradiance:{0:.2f} kWh/m2/year\n".format(maxValue)
        spacing    = ""

    return (
        "Photovoltaic (PV) System Performance Summary\n\n"
        "Note: The presented results are based on average system loss assumptions applied uniformly across all evaluated buildings to streamline the assessment process. "
        "Consequently, these figures may slightly overestimate real-world performance. For more accurate projections, individual building assessments are recommended.\n\n"
        "{locationInfo}"
        "2.PV System Installation Details:\n\n"
        "Total Rooftop area:{roofs_total:.2f}m2.\n"
        "Reduction coefficient:{red_coe}% of total roof area.\n"
        "Rooftop area utilized:{roofs_used:.2f}m2.\n"
        "Effective area of the panels: {eff_area:.2f} m2\n"
        "Number of Installed Panels: {panels} units\n"
        "{spacing}"
        "Panel Dimensions: {length} m x {width} m\n"
        "Total Installed Capacity: {capacity:.2f} kWp\n\n"
        "3. PV Panel Technical Specifications:\n"
        "Panel Capacity: {cap} Wp\n"
        "Efficiency: {eff_pct}%\n\n"
        "Energy production:\n"
        "{solarPower}"
        "System losses: {loss_pct:.2f}% (average value applied across all buildings).\n"
        "Estimated Annual Energy Production: {production}.\n"
    ).format(
        locationInfo  = pv_pack['locationInfo'],
        roofs_total   = sum(roofs_area),
        red_coe       = reduction_coe * 100,
        roofs_used    = sum(possible_roofs_installation),
        eff_area      = sum(pv_effective_area),
        panels        = sum(possible_panels_installation),
        spacing       = spacing,
        length        = PV_system['length'],
        width         = PV_system['width'],
        capacity      = sum(possible_panels_installation) * (PV_system['cap'] / 1000.0),
        cap           = int(PV_system['cap']),
        eff_pct       = int(PV_system['eff'] * 100),
        solarPower    = solarPower,
        loss_pct      = (1 - losses) * 100,
        production    = handelProducationValue(production)
    )


def info_provider_single_building(roofs, pts, res, pv_effective_area, eff, isInclined):
    Production = []
    if isInclined:
        res   = res[:-1]
        pts   = pts[:-1]
        roofs = roofs[:-1]

    GHI = max(res)
    for i, roof in enumerate(roofs):
        geo    = gh.Extrude(roof, gh.UnitZ(1))
        values = []
        for j, pt in enumerate(pts):
            if gh.PointInBrep(geo, pt, False) == 1:
                values.append(res[j])
        if not values:
            Production.append(0)
        else:
            Production.append(cal_Production(values, pv_effective_area[i], eff, GHI))
    return Production


def checkRequiredInputs(roofs, pts, res, pv_pack):
    errors  = []
    message = ""
    if gh.ListLength(res) <= 1:
        errors.append("Result list is empty or failed to collect.")
    if not roofs or gh.ListLength(roofs) == 0:
        errors.append("Roof geometry is missing.")
    if not pts or gh.ListLength(pts) < 1:
        errors.append("Analysis points are missing.")
    if not pv_pack:
        errors.append("PV data pack from 'PV_initializer' is required.")
    if reduction_coefficient > 1 or reduction_coefficient == 0:
        errors.append(
            "reduction_coefficient is a value from 0 to 1 which presents but got {0}.".format(reduction_coefficient)
        )
    if errors:
        numbered_errors = ["{0}-{1}".format(i + 1, err) for i, err in enumerate(errors)]
        message = (
            "\nRequired Inputs Missing:\n"
            + "\n".join(numbered_errors)
            + "\n\nPlease check the following inputs' error."
        )
        raise RuntimeError(message)


information = None
try:
    checkRequiredInputs(_roofs, _points, _result, _pv_data_pack)

    reduction_coe = 0.5 if reduction_coefficient is None else reduction_coefficient
    PV_system     = {"eff": 0.21, "length": 1.564, "width": 1.144, "cap": 360} if PV_system is None else json.loads(PV_system)
    pv_pack       = json.loads(_pv_data_pack)
    single_pro    = False if _generate_single_building_ is None else _generate_single_building_

    (tilted_panel_length,
     panel_area_required,
     distance_within_PV) = find_distance(pv_pack, PV_system)

    (roofs_area,
     possible_roofs_installation,
     possible_panels_installation,
     pv_effective_area,
     pv_occupied_area) = cal_PV_installation(_roofs, panel_area_required, distance_within_PV, pv_pack, PV_system)

    isInclined = True if pv_pack["spacing"][1] != 0 else False
    isMonthly  = pv_pack["period"] == "monthly"

    if single_pro:
        if isMonthly:
            raise RuntimeError("Monthly production calculation is not available for a single building.")
        information = info_provider_single_building(
            _roofs, _points, _result, pv_effective_area, PV_system["eff"], isInclined)

    if not isMonthly and not single_pro:
        production  = info_provider_general_yearly(_result, pv_effective_area, PV_system["eff"], isInclined)
        information = build_summary(
            roofs_area,
            possible_roofs_installation,
            pv_effective_area,
            possible_panels_installation,
            reduction_coe,
            pv_pack,
            PV_system,
            max(_result),
            get_Losses(_result),
            production,
            isInclined,
            distance_within_PV)

    elif isMonthly and not single_pro:
        information = info_provider_general_monthly(
            _result, pv_effective_area, PV_system["eff"], isInclined)

except Exception as e:
    ghc.add_warning("{0}".format(e))
# ---------- end pv_estimator ----------

information = Panel(pv_estimator)
